% Simulink data dictionary DPF_Data_Dictionary.sldd
% references DPF_Data_Dictionary.sldd
% references Scr_Regeneration.sldd

rpm_1500 = Simulink.Parameter(1500, DataType="uint16")
Soot_Deposition_Auto_80 = Simulink.Parameter(80, DataType="uint8")
Soot_Deposition_Manual_80 = Simulink.Parameter(80, DataType="uint8")
Break_Pedal_0 = Simulink.Parameter(0, DataType="boolean")
Accelerator_Pedal_0 = Simulink.Parameter(0, DataType="boolean")
Clutch_Pedal_0 = Simulink.Parameter(0, DataType="boolean")
Crank_Angle_10 = Simulink.Parameter(10, DataType="uint16")
Crank_Angle_35 = Simulink.Parameter(35, DataType="uint16")
Crank_Angle_190 = Simulink.Parameter(190, DataType="uint16")
Crank_Angle_215 = Simulink.Parameter(215, DataType="uint16")
Crank_Angle_370 = Simulink.Parameter(370, DataType="uint16")
Crank_Angle_395 = Simulink.Parameter(395, DataType="uint16")
Crank_Angle_550 = Simulink.Parameter(550, DataType="uint16")
Crank_Angle_575 = Simulink.Parameter(575, DataType="uint16")
Soot_Deposition_Service_95 = Simulink.Parameter(95, DataType="uint8")
Coolant_Temp_80 = Simulink.Parameter(80, DataType="int16")
DPF_Temp_Auto_250 = Simulink.Parameter(250, DataType="int16")
Ref_DPF_Temp_For_Auto_Regn = mpt.Signal(DataType="int16")
Ref_Engn_Coolant_Temp = mpt.Signal(DataType="int16")
Ref_Veh_Speed = mpt.Signal(DataType="uint8")
Ref_Engn_rpm = mpt.Signal(DataType="uint16")
Ref_Soot_Dep_For_Auto_Regn = mpt.Signal(DataType="uint8")
Ref_Soot_Dep_For_Servc_Regn_95 = mpt.Signal(DataType="uint8")
Auto_Regeneration_ON = mpt.Signal(DataType="boolean")
Press_Regeneration_Button = mpt.Signal(DataType="boolean")
Manual_Regeneration_Start = mpt.Signal(DataType="boolean")
Post_Injector2 = mpt.Signal(DataType="boolean")
Post_Injector1 = mpt.Signal(DataType="boolean")
Post_Injector4 = mpt.Signal(DataType="boolean")
Post_Injector3 = mpt.Signal(DataType="boolean")
Visit_Workshop_Immediately = mpt.Signal(DataType="boolean")
Coolant_Temp = mpt.Signal()
Vehicle_Speed = mpt.Signal()
rpm = mpt.Signal()
Soot_Deposition_Auto = mpt.Signal()
DPF_Temp_Auto = mpt.Signal()
Soot_Deposition_Manual = mpt.Signal()
DPF_Temp_Manual = mpt.Signal()
Break_Pedal = mpt.Signal()
Accelerator_Pedal = mpt.Signal()
Clutch_Pedal = mpt.Signal()
Crank_Angle = mpt.Signal()
Soot_Deposition_Service = mpt.Signal()
Vehicle_Speed_55 = Simulink.Parameter(55, DataType="uint8")
DPF_Temp_Manual_200 = Simulink.Parameter(200, DataType="int16")
Nox_Sensor = mpt.Signal(StorageClass="Global")
Scr_Temp_Sensor = mpt.Signal(StorageClass="Global")
Adblue_Level = mpt.Signal(StorageClass="Global")
Adblue_Quality = mpt.Signal(StorageClass="Global")