test file "Eas_Test"

suite "MIL"

  case "Functional_Test" [baseline]
    test data file: Eas_Functional_Test.xlsx
    model Eas_Integrated, harness Eas_Integrated_Harness
    input "Eas_Test11" from Eas_Functional_Test.xlsx, mapped to Coolant_Temp, Vehicle_Speed, rpm, Soot_Deposition_Auto, DPF_Temp_Auto, Soot_Deposition_Manual, DPF_Temp_Manual, Break_Pedal, Accelerator_Pedal, Clutch_Pedal, Crank_Angle, Soot_Deposition_Service, Nox_Sensor, Scr_Temp_Sensor, Adblue_Level, Adblue_Quality (active)
    logged signals "Signal Set 1": Auto_Regeneration_ON, Press_Regeneration_Button, Manual_Regeneration_Start, Post_Injector2, Post_Injector1, Post_Injector4, Post_Injector3, Visit_Workshop_Immediately, Adblue_Injection_Time, Adblue_level_display
    baseline "Eas_Test11"
      Auto_Regeneration_ON
      Manual_Regeneration_Start
      Post_Injector2
      Post_Injector1
      Post_Injector4
      Post_Injector3
      Press_Regeneration_Button
      Visit_Workshop_Immediately
      Adblue_Injection_Time
      Adblue_level_display
      Auto_Regeneration_ON
      Press_Regeneration_Button
      Manual_Regeneration_Start
      Post_Injector2
      Post_Injector1
      Post_Injector4
      Post_Injector3
      Visit_Workshop_Immediately
      Adblue_Injection_Time
      Adblue_level_display

suite "SIL"

  case "Functional_Test" [equivalence]
    simulation 1:
      model Eas_Integrated, harness Eas_Integrated_Harness, mode Normal
      input "Eas_Test11" from Eas_Functional_Test.xlsx, mapped to Coolant_Temp, Vehicle_Speed, rpm, Soot_Deposition_Auto, DPF_Temp_Auto, Soot_Deposition_Manual, DPF_Temp_Manual, Break_Pedal, Accelerator_Pedal, Clutch_Pedal, Crank_Angle, Soot_Deposition_Service, Nox_Sensor, Scr_Temp_Sensor, Adblue_Level, Adblue_Quality (active)
      logged signals "Signal Set 1": Auto_Regeneration_ON, Press_Regeneration_Button, Manual_Regeneration_Start, Post_Injector2, Post_Injector1, Post_Injector4, Post_Injector3, Visit_Workshop_Immediately, Adblue_Injection_Time, Adblue_level_display
    simulation 2:
      model Eas_Integrated, harness Eas_Integrated_Harness, mode Software-in-the-Loop (SIL)
      input "Eas_Test11" from Eas_Functional_Test.xlsx, mapped to Coolant_Temp, Vehicle_Speed, rpm, Soot_Deposition_Auto, DPF_Temp_Auto, Soot_Deposition_Manual, DPF_Temp_Manual, Break_Pedal, Accelerator_Pedal, Clutch_Pedal, Crank_Angle, Soot_Deposition_Service, Nox_Sensor, Scr_Temp_Sensor, Adblue_Level, Adblue_Quality (active)
      logged signals "Signal Set 1": Auto_Regeneration_ON, Press_Regeneration_Button, Manual_Regeneration_Start, Post_Injector2, Post_Injector1, Post_Injector4, Post_Injector3, Visit_Workshop_Immediately, Adblue_Injection_Time, Adblue_level_display
    equivalence criteria
      Auto_Regeneration_ON
      Manual_Regeneration_Start
      Post_Injector1
      Post_Injector4
      Post_Injector3
      Post_Injector2
      Press_Regeneration_Button
      Visit_Workshop_Immediately
      Adblue_Injection_Time
      Adblue_level_display
      Auto_Regeneration_ON
      Press_Regeneration_Button
      Manual_Regeneration_Start
      Post_Injector2
      Post_Injector1
      Post_Injector4
      Post_Injector3
      Visit_Workshop_Immediately
      Adblue_Injection_Time
      Adblue_level_display