% Simulink data dictionary Scr_Regeneration.sldd
% references Scr_Regeneration.sldd

Off = Simulink.Parameter(0, DataType="boolean")
On = Simulink.Parameter(1, DataType="boolean")
Tank_Condition = Simulink.Parameter(0, DataType="boolean")
Lamp_On = Simulink.Parameter(0, DataType="boolean")
Lamp_Off = Simulink.Parameter(1, DataType="boolean")
Scr_Temp_Level = Simulink.Signal()
Nozzle_Flow_Rate = Simulink.Signal()
Var = Simulink.Parameter(2, DataType="uint8")
Dcrg_Press = Simulink.Parameter(6, DataType="uint8")
Adblue_Low_Level = Simulink.Parameter(20, DataType="uint8")
Adblue_Injection_Time = Simulink.Signal()
Adblue_Quality_Level = Simulink.Signal()
Constant = Simulink.Parameter(3, DataType="uint8")
scr_temp200 = Simulink.Parameter(200, DataType="uint16")
Nozzle_FlowRate = Simulink.Parameter(0.099, DataType="double")
Nozzle_Area = Simulink.Parameter(1.13e-6, DataType="double")
Adblue_Concentration_1 = Simulink.Parameter(31.8, DataType="double")
Adblue_Concentration_2 = Simulink.Parameter(33.2, DataType="double")